% Simulink data dictionary Satelite_Dynamics.sldd

InitialAttitude_deg = Simulink.Parameter([12 31 -40], DataType="single", Unit="deg")
FinalDesiredAttitude_deg = Simulink.Parameter([40 -30 90], DataType="single", Unit="deg")
InitialBodyRates_degps = Simulink.Parameter([10 -20 12], DataType="single", Unit="deg/s")
FinalDesiredBodyRates_degps = Simulink.Parameter([0 0 0], DataType="single", Unit="deg/s")
SatelliteInertia = Simulink.Parameter([1.1 0.05 0; 0.05 1.9 -0.01; 0 -0.01 1.12], DataType="single", Unit="kg*m^2")
ReactionWheelCount = Simulink.Parameter(3, DataType="single")
DisturbanceTorqueType = Simulink.Parameter("Sinusoidal", DataType="string")
DisturbanceTorqueAmplitude_Nm = Simulink.Parameter(1.0e-6, DataType="single", Unit="N*m")